# Grasshopper definition assembled_speckle.gh (Grasshopper 1.0.7)
# plug-ins: Speckle 2, eleFront, eleFront Rhino 6 Legacy, Bifocals

panel = Panel("BakedStudioMarsTopoMain")
layer_r6 = DefineLayerR6(Name=panel)
getuv = GetUserValue()
ef_layer = EleFrontLayer(Layer=panel)  # -> Layer, FullPath, Hidden, Locked, DisplayColour, MaterialName, Linetype, PrintColour, PrintWidth
reflay = ReferenceByLayer(LayerName="Roof", lightweight=False)
ef_layer_2 = EleFrontLayer(Layer=layer_r6)  # -> Layer, FullPath, Hidden, Locked, DisplayColour, MaterialName, Linetype, PrintColour, PrintWidth
bklay = BakeLayers(Bake=False)
panel_2 = Panel(reflay)
filtername = FilterByName(Name="*", invertFilter=False, returnNulls=False)  # -> ExcludedGeometry, IncludedGeometry

# ---- group: BIMSC-PROJECT
# Send a message to James M. to add
# new materials. This list will be updated
# for all groups to have a common material
# library and common material names.
panel_3 = Panel("FRAGMENTS OF A MARTIAN ROSE")
bimsc_project = Text(panel_3)

# ---- group: FLOOR_LEVELS
# Set your 'Project' name, your 'Group'
# number, your 'Volume' Location that
# connect wirelessly.
series = Series(Start=0, Step=1, Count="5")
expression = Expression(x=series, Expression="Format(\"{0:00}\", x)")
# PROJECT
# INPUTS
concat = Concatenate(FragmentA="L", FragmentB=expression)  # -> simplify(graft(Result))
floor_levels = Text(concat)

# ---- group: RECEIVE MATERIALS
# RECIEVE
# MATERIALS
panel_4 = Panel("https://macad.speckle.xyz/streams/4975f9f0a8/branches/site%2F05-materials")
receive = Receive(
    Stream=panel_4,
    AutoReceive=False,
    CurrentComponentState="up_to_date",
    ExpandOutput=True,
    LastInfoMessage="James McBennett @ 03/02/2024 01:57:29: Materials 01-03-2024 (id:6ecf38526e)",
    ReceiveOnOpen=False,
    ReceivedCommitId="6ecf38526e",
    StreamWrapper="https://macad.speckle.xyz/streams/4975f9f0a8/branches/site/05-materials",
    selectedKitName="Objects")  # -> Info, Materials
dso = DeconstructSpeckleObject(SpeckleObject=receive.Materials, selectedKitName="Objects")  # -> Glass, Inflatable, Insulation, Mineral, Regolith, Site, Soil, Steel

# ---- group: BIMSC-ORIGINATOR
bimsc_originator = Text("G06")

# ---- group: BIMSC-VOLUME
bimsc_volume = Text("A4")

# ---- group: WorksForBrepsAndMeshes
list = ValueList({"Srf/Brep": 0, "Mesh": 1}, selected="Mesh")

# ----
srf = Surface([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])
mesh = Mesh([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])
srf_2 = Surface(Tree({0}: [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], {1}: [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], {2}: [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], {3}: [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], {4}: [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]))
mesh_2 = Mesh(Tree({0}: [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], {1}: [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], {2}: [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], {3}: [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], {4}: [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]))
brep = Brep(Tree({0}: [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], {1}: [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], {2}: [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], {3}: [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], {4}: [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]))
mesh_3 = Mesh(Tree({0}: [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], {1}: [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], {2}: [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], {3}: [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], {4}: [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]))

# ---- group: Alternative Method Using Extend Speckle Object by Key/Value / LEVEL
floor_levels_2 = Text(floor_levels)

# ---- group: Alternative Method Using Extend Speckle Object by Key/Value / PHASE
# ALTERNATIVE
num = Number(Tree({0}: [1], {1}: [1], {2}: [2], {3}: [2], {4}: [3]))

# ---- group: SiteCutCrv
crv = Curve(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)

# ---- group: NewSiteMesh
# SITE
mesh_4 = Mesh(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)

# ----
srf_3 = Surface(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)

merge = Merge(Data1=flatten(crv), Data2=flatten(mesh_4))  # -> simplify(graft(Result))
name = ExtendSpeckleObject(
    SpeckleObject=merge,
    BIMSCPROJECT=bimsc_project,
    BIMSCORIGINATOR=bimsc_originator,
    BIMSCVOLUME=bimsc_volume,
    BIMSCLEVEL="L00",
    BIMSCTYPE="SITE",
    BIMSCMATERIAL="SITE",
    RenderMaterial=dso.Site,
    BIMSCPHASE="1",
    selectedKitName="Objects")  # -> flatten(ExtendedSpeckleObject)

# ---- group: LEVEL
txt = Text(Tree({0}: ["L00"], {1}: ["L04"]))

# ---- group: PHASE
num_2 = Number(Tree({0}: [1], {1}: [1], {2}: [2], {3}: [2], {4}: [3]))

num_3 = Number(Tree({0}: [1], {1}: [3]))

# ----
# ASSIGN MATERIALS
# AND FILTERS
filter = StreamFilter(Gate=list, Stream0=srf, Stream1=mesh)  # -> reverse(simplify(graft(Stream)))
name_2 = ExtendSpeckleObject(
    SpeckleObject=filter,
    BIMSCPROJECT=bimsc_project,
    BIMSCORIGINATOR=bimsc_originator,
    BIMSCVOLUME=bimsc_volume,
    BIMSCLEVEL=txt,
    BIMSCTYPE="ROOF",
    BIMSCMATERIAL="REGOLITH",
    RenderMaterial=dso.Regolith,
    BIMSCPHASE=num_3,
    selectedKitName="Objects")

# ---- group: LEVEL
floor_levels_3 = Text(floor_levels)

# ----
filter_2 = StreamFilter(Gate=list, Stream0=srf_2, Stream1=mesh_2)
name_3 = ExtendSpeckleObject(
    SpeckleObject=filter_2,
    BIMSCPROJECT=bimsc_project,
    BIMSCORIGINATOR=bimsc_originator,
    BIMSCVOLUME=bimsc_volume,
    BIMSCLEVEL=floor_levels_3,
    BIMSCTYPE="WINDOW",
    BIMSCMATERIAL="GLASS",
    RenderMaterial=dso.Glass,
    BIMSCPHASE=num_2,
    selectedKitName="Objects")  # -> flatten(ExtendedSpeckleObject)

# ---- group: Alternative Method Using Extend Speckle Object by Key/Value
# Alternative method using keys and
# values. You will need to 'cross reference'
# or 'repeat-duplicate' data to create the
# correct set of keys and values for your
# model as in panel on the right.
panel_5 = Panel("WINDOW")
crossref = CrossReference(
    ListBIMSCPROJECT=bimsc_project,
    ListBIMSCORIGINATOR=bimsc_originator,
    ListBIMSCVOLUME=bimsc_volume,
    ListBIMSCLEVEL=floor_levels_2,
    ListBIMSCTYPE=panel_5,
    ListBIMSCMATERIAL="GLASS",
    ListRenderMaterial=dso.Glass,
    ListBIMSCPHASE=num,
    CrossMode=1)  # -> ListBIMSCPROJECT, ListBIMSCORIGINATOR, ListBIMSCVOLUME, ListBIMSCLEVEL, ListBIMSCTYPE, ListBIMSCMATERIAL, ListRenderMaterial, ListBIMSCPHASE
merge_2 = Merge(
    Data1=crossref.ListBIMSCPROJECT,
    Data2=crossref.ListBIMSCORIGINATOR,
    Data3=crossref.ListBIMSCVOLUME,
    Data4=crossref.ListBIMSCLEVEL,
    Data5=crossref.ListBIMSCTYPE,
    Data6=crossref.ListBIMSCMATERIAL,
    Data7=crossref.ListRenderMaterial,
    Data8=crossref.ListBIMSCPHASE)
panel_6 = Panel("""BIMSC-PROJECT
BIMSC-ORIGINATOR
BIMSC-VOLUME
BIMSC-LEVEL
BIMSC-TYPE
BIMSC-MATERIAL
renderMaterial
BIMSC-PHASE""")
panel_7 = Panel(merge_2)
esokv = ExtendSpeckleObjectByKeyValue(SpeckleObject=filter_2, Keys=panel_6, Values=merge_2, selectedKitName="Objects")  # -> flatten(ExtendedSpeckleObject)

# ---- group: PHASE
num_4 = Number(Tree({0}: [1], {1}: [1], {2}: [2], {3}: [2], {4}: [3]))

# ---- group: LEVEL
floor_levels_4 = Text(floor_levels)

# ----
filter_3 = StreamFilter(Gate=list, Stream0=brep, Stream1=mesh_3)
lng = ListLength(List=filter_3)
series_2 = Series(Start=0, Step=1, Count=lng)
# If you would like to set your own
# Speckle Material Properties, do
# so with this component. You can
# use this setup to create gradients.
gradient = Gradient(
    LowerLimit=0,
    UpperLimit=lng,
    Parameter=series_2,
    stops=[0: RGB(234, 38, 0), 0.25: RGB(234, 126, 0), 0.5: RGB(254, 244, 84), 0.75: RGB(173, 203, 249), 1: RGB(75, 107, 169)])
sso = RenderMaterial(
    Opacity=Slider(1, range=0..1),
    Metalness=0,
    Roughness=1,
    Diffuse=gradient,
    SelectedConstructorName="Objects.Other.RenderMaterial.ctor(System.Double,System.Double,System.Double,System.Nullable`1[System.Drawing.Color],System.Nullable`1[System.Drawing.Color])",
    SelectedTypeName="Objects.Other.RenderMaterial",
    UseSchemaTag=False,
    UserSetSchemaTag=False,
    seed="8778421604ba247de87e")  # -> simplify(SpeckleObject)
name_4 = ExtendSpeckleObject(
    SpeckleObject=filter_3,
    BIMSCPROJECT=bimsc_project,
    BIMSCORIGINATOR=bimsc_originator,
    BIMSCVOLUME=bimsc_volume,
    BIMSCLEVEL=floor_levels_4,
    BIMSCTYPE="WALL",
    BIMSCMATERIAL="REGOLITH",
    RenderMaterial=sso,
    BIMSCPHASE=num_4,
    selectedKitName="Objects")  # -> flatten(ExtendedSpeckleObject)

panel_8 = Panel("https://macad.speckle.xyz/streams/4975f9f0a8/branches/site/04-community-site")
receive_2 = Receive(
    Stream=panel_8,
    AutoReceive=False,
    CurrentComponentState="up_to_date",
    ExpandOutput=True,
    LastInfoMessage="James McBennett @ 03/01/2024 23:14:17: 2024 Mar-01 (id:9ec35295b2)",
    ReceiveOnOpen=False,
    ReceivedCommitId="9ec35295b2",
    StreamWrapper="https://macad.speckle.xyz/streams/4975f9f0a8/branches/site/04-community-site",
    selectedKitName="Objects")  # -> Info, CONTOURS, SOIL
# EDIT SITE MESH
item = ListItem(List=flatten(receive_2.SOIL), Index=Slider(3, range=0..17), Wrap=True)
bbox = BoundingBox(Content=srf_3, Plane=PlaneXY(0, 0, 0))  # -> Box, Box_2
volume = Volume(Geometry=bbox.Box)  # -> Volume, Centroid
msphere = MeshSphere(Base=volume.Centroid, Radius="30000", UCount="100", VCount="100")
msplit = MeshSplit(Mesh=item, Splitters=msphere)

mmx = MeshMesh(MeshA=item, MeshB=msphere)

# ----
# SEND
panel_9 = Panel("https://macad.speckle.xyz/streams/fb7821e9f3/branches/main")
cso = CreateSpeckleObject(ROOF=name_2, WALL=name_4, WINDOW=name_3, SITE=name, selectedKitName="Objects")
send = Send(
    Stream=panel_9,
    Message="Test",
    D=cso,
    AutoSend=False,
    BaseId="6a982903f45783bb54a2832a9ef6a595",
    CurrentComponentState="expired",
    KitName="Objects",
    OutputWrappers="https://macad.speckle.xyz\tfb7821e9f3\tcd98566eea",
    UseDefaultCache=True,
    selectedKitName="Objects")
